# Grasshopper definition ColorReader.gh (Grasshopper 1.0.7)

# ---- group: INPUTS
context_geo = Geometry([<brep referenced from the Rhino model> x5])
building_geo = Geometry(<brep referenced from the Rhino model>)
save = Button()
save_boxes = BooleanToggle(True)
boxes_color = ColourSwatch(SwatchColor=RGB(0, 0, 0))

# ----
plane_size = Slider(64, range=0..100)

# ---- group: Source Path
panel = Panel("E:\GitRepo\pix2pix_IF_workshop\Pix2Pix_Project\generate\source")
path = FilePath(panel)

# ---- group: Result Path
panel_2 = Panel("E:\GitRepo\pix2pix_IF_workshop\Pix2Pix_Project\generate\result")
path_2 = FilePath(panel_2)

# ----
preview_size = Slider(0.5, range=0..1)
c_script = CSharpScript(planeSize=plane_size, folder=path_2)  # -> out, points; inputs planeSize: Int32, folder: String
# ---------- c_script: C# usings ----------
using System.Drawing;
using System.IO;
using System.Linq;
# ---------- c_script: C# ----------
    string[] imagesPaths = Directory.GetFiles(folder, "*.png");

    List<Point3d> generatedPoints = new List<Point3d>();
    for (int i = 0; i < imagesPaths.Length; i++)
    {
      string path = imagesPaths[i];
      Bitmap img = ResizeImage(new Bitmap(path), planeSize);

      for (int x = 0; x < img.Size.Width; x++)
      {
        for (int y = 0; y < img.Size.Height; y++)
        {
          var pix = img.GetPixel(x, y);
          bool r = pix.R < 60;
          bool g = pix.G < 60;
          bool b = pix.B < 60;
          if (r && g && b)
          {
            Point3d newPoint = new Point3d(x, planeSize - y, i);
            generatedPoints.Add(newPoint);
          }
        }
      }
    }
    points = generatedPoints;
# ---------- c_script: C# additional code ----------
  private Bitmap ResizeImage(Bitmap image, int size)
  {
    Rectangle destRect = new Rectangle(0, 0, size, size);
    Bitmap destImage = new Bitmap(size, size);
    destImage.SetResolution(image.HorizontalResolution, image.VerticalResolution);

    using (var graphics = Graphics.FromImage(destImage))
    {
      graphics.CompositingMode = System.Drawing.Drawing2D.CompositingMode.SourceCopy;
      graphics.CompositingQuality = System.Drawing.Drawing2D.CompositingQuality.AssumeLinear;
      graphics.InterpolationMode = System.Drawing.Drawing2D.InterpolationMode.NearestNeighbor;
      graphics.SmoothingMode = System.Drawing.Drawing2D.SmoothingMode.HighQuality;
      graphics.PixelOffsetMode = System.Drawing.Drawing2D.PixelOffsetMode.Half;

      graphics.DrawImage(image, destRect, 0, 0, image.Width, image.Height, GraphicsUnit.Pixel);
    }
    return destImage;
  }
# ---------- end c_script ----------
box = CenterBox(Base=c_script.points, X=preview_size, Y=preview_size, Z=preview_size)
Z = UnitZ(Factor=preview_size)

# ---- group: VOXELIZER - BUILDING
bbox = BoundingBox(Content=building_geo, Plane=PlaneXY(0, 0, 0))  # -> Box, Box_2
debox = DeconstructBox(Box=bbox.Box)  # -> Plane, X, Y, Z
dedomain = DeconstructDomain(Domain=debox.Y)  # -> Start, End
dedomain_2 = DeconstructDomain(Domain=debox.Z)  # -> Start, End
dedomain_3 = DeconstructDomain(Domain=debox.X)  # -> Start, End
subtraction = Subtraction(A=dedomain.End, B=dedomain.Start)
subtraction_2 = Subtraction(A=dedomain_2.End, B=dedomain_2.Start)
subtraction_3 = Subtraction(A=dedomain_3.End, B=dedomain_3.Start)
lng = ListLength(List=bbox.Box)
pt = ConstructPoint(XCoordinate=dedomain_3.Start, YCoordinate=dedomain.Start, ZCoordinate=dedomain_2.Start)
X = UnitX(Factor=1)
larger = LargerThan(FirstNumber=lng, SecondNumber=1)  # -> LargerThan, OrEqualTo
arrlinear = LinearArray(Geometry=pt, Direction=X, Count=subtraction_3)  # -> simplify(Geometry), Transform
Y = UnitY(Factor=1)
python = GhPythonScript(x=larger.LargerThan)  # -> a
# ---------- python: Python ----------
if x:
    a = 1
else:
    a = 0
# ---------- end python ----------
arrlinear_2 = LinearArray(Geometry=arrlinear.Geometry, Direction=Y, Count=graft(subtraction))  # -> simplify(Geometry), Transform
Z_2 = UnitZ(Factor=1)
trim = TrimTree(Tree=arrlinear_2.Geometry, Depth=python)
arrlinear_3 = LinearArray(Geometry=trim, Direction=Z_2, Count=graft(subtraction_2))  # -> Geometry, Transform
brepinc = PointInBrep(Brep=building_geo, Point=arrlinear_3.Geometry, Strict=False)
dispatch = Dispatch(List=arrlinear_3.Geometry, DispatchPattern=brepinc)  # -> ListA, ListB
clean = CleanTree(RemoveNulls=True, RemoveInvalid=True, RemoveEmpty=True, Tree=dispatch.ListA)  # -> flatten(Tree)

# ----
move = Move(Geometry=box, Motion=Z)  # -> Geometry, Transform

# ---- group: VOXELIZER - CONTEXT
bbox_2 = BoundingBox(Content=context_geo, Plane=PlaneXY(0, 0, 0))  # -> Box, Box_2
debox_2 = DeconstructBox(Box=bbox_2.Box)  # -> Plane, X, Y, Z
dedomain_4 = DeconstructDomain(Domain=debox_2.Y)  # -> Start, End
dedomain_5 = DeconstructDomain(Domain=debox_2.Z)  # -> Start, End
dedomain_6 = DeconstructDomain(Domain=debox_2.X)  # -> Start, End
subtraction_4 = Subtraction(A=dedomain_4.End, B=dedomain_4.Start)
subtraction_5 = Subtraction(A=dedomain_5.End, B=dedomain_5.Start)
subtraction_6 = Subtraction(A=dedomain_6.End, B=dedomain_6.Start)
lng_2 = ListLength(List=bbox_2.Box)
pt_2 = ConstructPoint(XCoordinate=dedomain_6.Start, YCoordinate=dedomain_4.Start, ZCoordinate=dedomain_5.Start)
X_2 = UnitX(Factor=1)
larger_2 = LargerThan(FirstNumber=lng_2, SecondNumber=1)  # -> LargerThan, OrEqualTo
arrlinear_4 = LinearArray(Geometry=pt_2, Direction=X_2, Count=subtraction_6)  # -> simplify(Geometry), Transform
Y_2 = UnitY(Factor=1)
python_2 = GhPythonScript(x=larger_2.LargerThan)  # -> a; same code as python
arrlinear_5 = LinearArray(Geometry=arrlinear_4.Geometry, Direction=Y_2, Count=graft(subtraction_4))  # -> simplify(Geometry), Transform
Z_3 = UnitZ(Factor=1)
trim_2 = TrimTree(Tree=arrlinear_5.Geometry, Depth=python_2)
arrlinear_6 = LinearArray(Geometry=trim_2, Direction=Z_3, Count=graft(subtraction_5))  # -> flatten(Geometry), Transform

# ---- group: BUILDING RECTANGULAR BOUDARY VOXELS
pdecon = Deconstruct(Point=clean)  # -> XComponent, YComponent, flatten(ZComponent)
cset = CreateSet(List=flatten(pdecon.ZComponent))  # -> Set, Map
mindex = MemberIndex(Set=pdecon.ZComponent, Member=cset.Set)  # -> Index, Count
item = ListItem(List=flatten(clean), Index=mindex.Index, Wrap=True)
bbox_3 = BoundingBox(Content=item, Plane=PlaneXY(0, 0, 0), UnionBox=True)  # -> Box, Box_2
srf = Surface(bbox_3.Box)
debox_3 = DeconstructBox(Box=bbox_3.Box)  # -> Plane, X, Y, Z
dedomain_7 = DeconstructDomain(Domain=debox_3.Y)  # -> Start, End
dedomain_8 = DeconstructDomain(Domain=debox_3.X)  # -> Start, End
subtraction_7 = Subtraction(A=dedomain_7.End, B=dedomain_7.Start)
subtraction_8 = Subtraction(A=dedomain_8.End, B=dedomain_8.Start)
sdivide = DivideSurface(Surface=srf, UCount=subtraction_8, VCount=subtraction_7)  # -> flatten(Points), Normals, Parameters

# ---- group: Save Images
c_script_2 = CSharpScript(
    planeSize=plane_size,
    context=arrlinear_6.Geometry,
    buildingBoxes=clean,
    buildingBoxColor=boxes_color,
    path=path,
    box=save_boxes,
    run=save)  # -> out, cOut; inputs planeSize: Int32, context: list of Point3d, buildingBoxes: list of Point3d, buildingBoxColor: Color, path: String, box: Boolean, run: Boolean
# ---------- c_script_2: C# usings ----------
using System.Drawing;
using System.Drawing.Imaging;
using System.IO;
using System.Linq;
# ---------- c_script_2: C# ----------
    if(run)
    {
      // Create the bitmaps
      int buildingStart = buildingBoxes.Min(p => Convert.ToInt32(Math.Floor(p.Z)));
      int buildingEnd = buildingBoxes.Max(p => Convert.ToInt32(Math.Floor(p.Z)));
      int count = buildingEnd - buildingStart + 1;

      //int buildingHeight = layers.Count();

      //int count = buildingHeight;

      Bitmap[] images = new Bitmap[count];
      for (int i = 0; i < count; i++)
      {
        images[i] = new Bitmap(planeSize, planeSize);
        for (int x = 0; x < planeSize; x++)
        {
          for (int y = 0; y < planeSize; y++)
          {
            images[i].SetPixel(x, y, Color.White);
          }
        }
      }

      // Check if saving boxes
      if (box)
      {
        // Create the colour gradient list
        Color max = Color.Magenta;
        Color min = Color.Blue;

        int rMax = max.R;
        int rMin = min.R;

        int gMax = max.G;
        int gMin = min.G;

        int bMax = max.B;
        int bMin = min.B;

        var colorList = new List<Color>();
        for(int i = 0; i < count; i++)
        {
          var rAverage = rMin + (int) ((rMax - rMin) * i / (count - 1));
          var gAverage = gMin + (int) ((gMax - gMin) * i / (count - 1));
          var bAverage = bMin + (int) ((bMax - bMin) * i / (count - 1));
          colorList.Add(Color.FromArgb(rAverage, gAverage, bAverage));
        }

        // Read the Context points and assign to the correct image
        foreach(Point3d p in context)
        {
          int x = Convert.ToInt32(Math.Floor(p.X));
          int y = Convert.ToInt32(Math.Floor(p.Y));
          int z = Convert.ToInt32(Math.Floor(p.Z));
          if (z < count) images[z].SetPixel(x, planeSize - y, colorList[z]);
        }
      }


      // Read the Building points and assign to the correct image
      List<Point3d> source;
      Color c;

      source = buildingBoxes;
      c = buildingBoxColor;

      foreach(Point3d p in source)
      {
        int x = Convert.ToInt32(Math.Round(p.X));
        int y = Convert.ToInt32(Math.Round(p.Y));
        int z = Convert.ToInt32(Math.Round(p.Z)) - buildingStart;

        images[z].SetPixel(x, planeSize - y, c);
      }

      // Save the image
      for(int i = 0; i < count; i++)
      {
        var fileName = Path.Combine(path, "level " + i.ToString() + ".png");
        var fStream = File.Create(fileName);

        var image = images[i];
        int size = 256;

        Rectangle destRect = new Rectangle(0, 0, size, size);
        Bitmap destImage = new Bitmap(size, size);
        destImage.SetResolution(image.HorizontalResolution, image.VerticalResolution);

        using (var graphics = Graphics.FromImage(destImage))
        {
          graphics.CompositingMode = System.Drawing.Drawing2D.CompositingMode.SourceCopy;
          graphics.CompositingQuality = System.Drawing.Drawing2D.CompositingQuality.AssumeLinear;
          graphics.InterpolationMode = System.Drawing.Drawing2D.InterpolationMode.NearestNeighbor;
          graphics.SmoothingMode = System.Drawing.Drawing2D.SmoothingMode.HighQuality;
          graphics.PixelOffsetMode = System.Drawing.Drawing2D.PixelOffsetMode.Half;

          graphics.DrawImage(image, destRect, 0, 0, image.Width, image.Height, GraphicsUnit.Pixel);
        }
        destImage.Save(fStream, System.Drawing.Imaging.ImageFormat.Png);
        destImage.Dispose();
      }
    }
# ---------- end c_script_2 ----------

# ----
panel_3 = Panel(c_script_2.out)
